# Grasshopper definition Eabbit_NV.gh (Grasshopper 1.0.7)
# plug-ins: Eabbit_NV

# ---- group: Wind data
# Harvard Graduate School of Design
# This .gh file is created by Ellie Jungmin Han.
# __author__ = "jhan2harvard"
# __version__ = "2022.3.22"
data = Data([360, 350, 360, 10, 10, 360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])

# ---- group: CwCalculation
# West
# East
# South
# North
number_slider = Slider(0.532, range=0..10)
number_slider_2 = Slider(1.313, range=0..10)
number_slider_3 = Slider(1.313, range=0..10)
number_slider_4 = Slider(0.532, range=0..10)
number_slider_5 = Slider(3.15, range=0..10)
number_slider_6 = Slider(5.25, range=0..10)
number_slider_7 = Slider(3.15, range=0..10)
number_slider_8 = Slider(2.1, range=0..10)
number_slider_9 = Slider(2.1, range=0..10)
number_slider_10 = Slider(5.25, range=0..10)
number_slider_11 = Slider(90, range=0..360)
number_slider_12 = Slider(180, range=0..360)
number_slider_13 = Slider(270, range=0..360)
avr = Average(Input=data)
number_slider_14 = Slider(0, range=0..360)
number_slider_15 = Slider(5.25, range=0..10)
number_slider_16 = Slider(5.25, range=0..10)
number_slider_17 = Slider(3.5, range=0..10)
number_slider_18 = Slider(3.5, range=0..10)
number_slider_19 = Slider(3.5, range=0..10)
number_slider_20 = Slider(3.5, range=0..10)
panel = Panel("Façade orientation (S=180, N=0) [°]")

# ----
windpressurecoef = WindpressureCoef(
    DoubleWindDirection=avr,
    DoubleFacadeOrientation=number_slider_13,
    DoubleVerticalLocationOfOpening=number_slider_5,
    DoubleBuildingHeight=number_slider_17,
    DoubleHorizontalLocationOfOpening=number_slider,
    DoubleWidthOfFacade=number_slider_6,
    DoubleWidthOfAdjacentFacades=number_slider_6)  # -> StringLog, DoubleCw, DoubleCwAve
windpressurecoef_2 = WindpressureCoef(
    DoubleWindDirection=avr,
    DoubleFacadeOrientation=number_slider_12,
    DoubleVerticalLocationOfOpening=number_slider_9,
    DoubleBuildingHeight=number_slider_19,
    DoubleHorizontalLocationOfOpening=number_slider_3,
    DoubleWidthOfFacade=number_slider_16,
    DoubleWidthOfAdjacentFacades=number_slider_16)  # -> StringLog, DoubleCw, DoubleCwAve
windpressurecoef_3 = WindpressureCoef(
    DoubleWindDirection=avr,
    DoubleFacadeOrientation=number_slider_14,
    DoubleVerticalLocationOfOpening=number_slider_7,
    DoubleBuildingHeight=number_slider_20,
    DoubleHorizontalLocationOfOpening=number_slider_4,
    DoubleWidthOfFacade=number_slider_10,
    DoubleWidthOfAdjacentFacades=number_slider_10)  # -> StringLog, DoubleCw, DoubleCwAve
windpressurecoef_4 = WindpressureCoef(
    DoubleWindDirection=avr,
    DoubleFacadeOrientation=number_slider_11,
    DoubleVerticalLocationOfOpening=number_slider_8,
    DoubleBuildingHeight=number_slider_18,
    DoubleHorizontalLocationOfOpening=number_slider_2,
    DoubleWidthOfFacade=number_slider_15,
    DoubleWidthOfAdjacentFacades=number_slider_15)  # -> StringLog, DoubleCw, DoubleCwAve
building_geo = Brep([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])

floor = Surface(<surface referenced from the Rhino model>)
area = Area(Geometry=floor)  # -> Area, Centroid
data_2 = Data(area.Area)

# ---- group: CrossVentilation
brep = Brep(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)
awning = Slider(0.55, range=0..1)
number_slider_21 = Slider(1.69, range=0..10)
number_slider_22 = Slider(3.5, range=0..10)
brep_2 = Brep(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)

# ----
multiplication = Multiplication(A=area.Area, B=number_slider_22)
internalheatgain = InternalQ(DoubleFloorArea=data_2, DoubleHeatGainPerM2="35", IntOfPeople=Slider(2, range=0..10))
northcw = Data(-0.3660083864)
southcw = Data(0.5050906077)
data_3 = Data(internalheatgain)
data_4 = Data(area.Area)

# ---- group: WindowConfiguration
number_slider_23 = Slider(0.8, range=0..1)
number_slider_24 = Slider(1.5, range=0..10)
brep_3 = Brep(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)
number_slider_25 = Slider(0.8, range=0..1)
number_slider_26 = Slider(1.5, range=0..10)
number_slider_27 = Slider(10, range=0..10)
number_slider_28 = Slider(9, range=0..10)
srf = Surface(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)
srf_2 = Surface(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)
number_slider_29 = Slider(0.007, range=0..0.01)
number_slider_30 = Slider(40, range=0..100)
number_slider_31 = Slider(0.001, range=0..0.01)
number_slider_32 = Slider(20, range=0..100)
list = ValueList({"Sliding": 0, "Single Hung": 1, "Double Hung": 2, "Casement": 3, "Awning": 4, "Central pivot window": 5}, selected="Sliding")
list_2 = ValueList({"Sliding": 0, "Single Hung": 1, "Double Hung": 2, "Casement": 3, "Awning": 4, "Central pivot window": 5}, selected="Central pivot window")
toggle = BooleanToggle(True)
toggle_2 = BooleanToggle(True)
brep_4 = Brep(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)

# ----
windowfr = EWindowFrame(SurfaceForWindow=srf, IntForType=number_slider_27, Width=number_slider_23, Height=number_slider_24, BoolForFlip=False)  # -> Window, NormalVectors
windowfr_2 = EWindowFrame(SurfaceForWindow=srf_2, IntForType=number_slider_28, Width=number_slider_25, Height=number_slider_26, BoolForFlip=False)  # -> Window, NormalVectors

# ---- group: WindowConfiguration (continued)
rec = Rectangle(windowfr.Window)
rec_2 = Rectangle(windowfr_2.Window)
boundary = BoundarySurfaces(Edges=rec)
boundary_2 = BoundarySurfaces(Edges=rec_2)

# ----
windows = EWindow(
    SurfaceForWindow=boundary,
    IntForType=list,
    DoubleForSliding=number_slider_30,
    DoubleForGlazingGap=number_slider_29,
    DoubleForMaximumDepth=toggle,
    BoolForFlip=Toggle(False))  # -> Window, OpeningArea, OpeningArea_2
windows_2 = EWindow(
    SurfaceForWindow=boundary_2,
    IntForType=list_2,
    DoubleForSliding=number_slider_32,
    DoubleForGlazingGap=number_slider_31,
    DoubleForMaximumDepth=toggle_2,
    BoolForFlip=Toggle(True))  # -> Window, OpeningArea, OpeningArea_2

# ---- group: CrossVentilation / Meter
areacdeff_north = PythonScript(areaA=windows.OpeningArea, areaB=windows_2.OpeningArea, DisCoef=awning)  # -> out, AreaCdeff; inputs areaA: list, areaB: list
# ---------- areacdeff_north: Python ----------
import math 

print areaA
def inchesToMeterSQ(Lst):
    myLst = []
    for i in range(0,len(Lst)):
        myLst.append(float(Lst[i])*0.00064516)
    return myLst
    
#areaA = inchesToMeterSQ(areaA)
#areaB = inchesToMeterSQ(areaB)

def totalAreaCoeff(Areas,Cdeff):
	reversedAcdLst = []
	sumLst = 0

	for i in range (0,len(Areas)):
		Acd = Areas[i] * Cdeff [i]
		powerAcd = Acd**2
		reversedAcd = 1 / powerAcd
		# print "reversed",reversedAcd
		reversedAcdLst.append(reversedAcd) 
		# print reversedAcdLst
		sumLst += reversedAcd 
		# print math.sqrt(sumLst)
	
	return 1 / math.sqrt(sumLst)

#print type(area[0])

def areaSum(area):
    sumSoFar = 0
    for i in range(0,len(area)):
        sumSoFar += float(area[i])
    return sumSoFar

A = areaSum(areaA)
B = areaSum(areaB)

def makeLst(A,B):
    Lst = []
    Lst.append(A)
    Lst.append(B)
    return Lst
    
Areas = makeLst(A,B)

def stringToFloat(area):
    tempLst = []
    for i in range (0,len(area)):
        tempLst.append(float(area[i]))
    return tempLst

myCoef = float(DisCoef)

def coefLst(coef,Areas):
    coefLst = []
    for i in range(0,len(Areas)):
        coefLst.append(float(coef))
    return coefLst
    
    
    
ListCoef = coefLst(myCoef,Areas)
#Areas = stringToFloat(area)
#print type(ListCoef[0])
AreaCdeff = totalAreaCoeff(Areas,ListCoef)
# ---------- end areacdeff_north ----------

# ----
nvcrossventilation = NVCrossVentilation(
    DoubleAcdEff=areacdeff_north.AreaCdeff,
    DoubleWindVelocity=number_slider_21,
    DoubleCwIn=southcw,
    DoubleCwOut=northcw,
    DoubleHeatGain=data_3,
    DoubleFloorArea=data_4,
    DoubleRoomHeight=number_slider_22)  # -> DoubleFlowRate, DoubleDeltaT, DoubleACH

# ---- group: Visualization
gradient = Gradient(
    LowerLimit=0,
    UpperLimit=15,
    Parameter=nvcrossventilation.DoubleACH,
    stops=[0: RGB(172, 102, 3), 0: RGB(209, 238, 201), 0: RGB(234, 38, 0), 0.25: RGB(234, 126, 0), 0.5: RGB(254, 244, 84), 0.75: RGB(173, 203, 249), 1: RGB(75, 107, 169)])
building_geo_2 = Brep([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])
preview = CustomPreview(Geometry=floor, Shader=gradient)
